# Grasshopper definition assembly.ghx (Grasshopper 1.0.7)

# ----
# Robot
toggle = BooleanToggle(True)
ros = ROSConnect(connect=toggle)  # -> ros_client, is_connected; inputs port: Int32, connect: Boolean
#   port ip: The ip address ROS. Defaults to 127.0.0.1.
#   port port: The port of ROS. Defaults to 9090.
#   port connect: If True, connects to ROS. If False, disconnects from ROS. Defaults to False.
#   port ros_client: The ROS client.
#   port is_connected: True if connection established.
# ---------- ros: Python ----------
"""
Connect or disconnect to ROS.

COMPAS FAB v0.19.1
"""
from ghpythonlib.componentbase import executingcomponent as component
from scriptcontext import sticky as st

from compas_fab.backends import RosClient
from compas_fab.ghpython.components import create_id


class ROSConnect(component):
    def RunScript(self, ip, port, connect):
        ros_client = None

        ip = ip or '127.0.0.1'
        port = port or 9090

        key = create_id(self, 'ros_client')
        ros_client = st.get(key, None)

        if ros_client:
            st[key].close()
        if connect:
            st[key] = RosClient(ip, port)
            st[key].run(5)

        ros_client = st.get(key, None)
        is_connected = ros_client.is_connected if ros_client else False
        return (ros_client, is_connected)
# ---------- end ros ----------
robot = ROSRobot(ros_client=ros.ros_client, load=Toggle(True))  # -> robot; inputs load: Boolean
#   port ros_client: The ROS client.
#   port load: If True, loads the robot from ROS. Defaults to False.
# ---------- robot: Python ----------
"""
Load robot directly from ROS.

COMPAS FAB v0.19.1
"""
from compas_ghpython.artists import RobotModelArtist
from ghpythonlib.componentbase import executingcomponent as component
from scriptcontext import sticky as st

from compas_fab.ghpython.components import create_id


class ROSRobot(component):
    def RunScript(self, ros_client, load):
        key = create_id(self, 'robot')

        if ros_client and ros_client.is_connected and load:
            # Load URDF from ROS
            st[key] = ros_client.load_robot(load_geometry=True, precision='12f')
            st[key].artist = RobotModelArtist(st[key].model)

        robot = st.get(key, None)
        if robot:  # client sometimes need to be restarted, without needing to reload geometry
            robot.client = ros_client
        return robot
# ---------- end robot ----------
static = GhPythonScript(robot=robot)  # -> robot
# ---------- static: Python ----------
import compas_fab
from compas.datastructures import Mesh
from compas_fab.robots import CollisionMesh
from compas_fab.robots import PlanningScene

scene = PlanningScene(robot)
mesh = Mesh.from_stl(compas_fab.get('planning_scene/floor.stl'))
cm = CollisionMesh(mesh, 'floor')
scene.add_collision_mesh(cm)
# ---------- end static ----------

step = Slider(0, range=0..540)

# ----
# Assembly
mesh_uv = MeshSurface(Surface=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, UCount=24, VCount=46, Overhang=True, Equalize=False)
types = GhPythonScript()  # -> Assembly, Part
# ---------- types: Python ----------
from __future__ import print_function
from __future__ import absolute_import
from __future__ import division

import os
import sys

HERE = os.path.dirname(ghenv.Component.OnPingDocument().FilePath)

if HERE not in sys.path:
    sys.path.append(HERE)

from assembly import Assembly
from assembly import Part
# ---------- end types ----------
dam = DataDam(DataA=mesh_uv, BufferDelay=10000000, BufferMode=0)
python = GhPythonScript(mesh=dam, Assembly=types.Assembly, Part=types.Part)  # -> out, wall
# ---------- python: Python ----------
import math
from compas.geometry import Box
from compas.geometry import Frame
from compas.geometry import Vector
from compas.geometry import Transformation
from compas.geometry import Translation
from compas.geometry import Rotation
from compas_rhino.geometry import RhinoMesh
from compas.datastructures import Network
from compas.datastructures import Mesh

m = RhinoMesh.from_guid(mesh).to_compas()
brick = Box.from_width_height_depth(0.08, .03, .03)

wall = Assembly()
course = 0
last_z = None


for i, e in enumerate(m.faces()):
    if i % 2 == 0:
        continue
    x, y, z = m.face_centroid(e)
    
    if last_z is None or last_z != z:
        last_z = z
        course += 1

    xaxis = Vector(*list(m.face_normal(e))).cross(Vector(0, 0, 1))
    frame = Frame((x, y, z), xaxis, (0, 1, 0))
    nb = brick.transformed(Transformation.from_frame(frame))

    R = Rotation.from_axis_and_angle(frame.yaxis, math.radians(90), point=frame.point)
    T = Translation.from_vector((0, 0, 0.02))
    place_frame = frame.transformed(T * R)
    approach_frame = place_frame.transformed(Translation.from_vector((0, 0, 0.05)))

    part = Part(name=None, 
                frame=frame,
                place_frame=place_frame,
                approach_frame=approach_frame,
                shape=brick,
                course=course,                
                )
#    part.add_feature(Box.from_width_height_depth(0.03, 0.02, 0.03), 'difference')
    wall.add_part(part)
# ---------- end python ----------
save = GhPythonScript(wall=python.wall, save=Button())  # -> out
# ---------- save: Python ----------
import os

if save:
    HERE = os.path.dirname(ghenv.Component.OnPingDocument().FilePath)
    wall.to_json(os.path.join(HERE, 'wall.json'), pretty=True)
# ---------- end save ----------
viz_assembly = GhPythonScript(wall=python.wall, step=step)  # -> out, a
# ---------- viz_assembly: Python ----------
from compas.artists import Artist

a = []

for i, part in enumerate(wall.parts()):
    if i >step:
        break
    m = part.to_mesh()
    a.append(Artist(m).draw_mesh(color=(200, 65, 85)))
# ---------- end viz_assembly ----------

robot_2 = Data(static)
wall = Data(python.wall)
step_2 = Data(step)

# ----
# Home
number_slider = Slider(0, range=-400..400)
home = GhPythonScript(
    robot=robot_2,
    joints=[Slider(0, range=-400..400), Slider(-90, range=-400..400), Slider(90, range=-400..400), Slider(-90, range=-400..400), Slider(-90, range=-400..400), number_slider])  # -> config; inputs joints: list
# ---------- home: Python ----------
import math
from compas.robots import Configuration

config = robot.zero_configuration()
config.joint_values = list([math.radians(j) for j in joints])
print config
# ---------- end home ----------

# ----
# Approach frame
approach = GhPythonScript(wall=wall, step=step_2)  # -> frame, a; inputs step: Int32
# ---------- approach: Python ----------
import math
from compas.geometry import Rotation
from compas.geometry import Translation
from compas.artists import Artist

frame = list(wall.parts())[step].attributes['approach_frame']
a = Artist(frame).draw()
# ---------- end approach ----------
ik = InverseKinematics(robot=robot_2, plane=approach.frame, start_configuration=home)  # -> configuration
#   port plane: The plane or frame to calculate the inverse kinematic for.
#   port start_configuration: If passed, calculates the inverse such that the joint positions differ the least from the start_configuration. Defaults to the zero configuration.
#   port group: The planning group used for calculation. Defaults to the robot's main planning group.
#   port configuration: The planning group's configuration.
# ---------- ik: Python ----------
"""
Calculate the robot's inverse kinematic for a given plane.

COMPAS FAB v0.19.1
"""
from ghpythonlib.componentbase import executingcomponent as component

from compas_fab.ghpython.components import coerce_frame


class InverseKinematics(component):
    def RunScript(self, robot, plane, start_configuration, group):
        configuration = None
        if robot and robot.client and robot.client.is_connected and plane:
            frame = coerce_frame(plane)
            configuration = robot.inverse_kinematics(frame, start_configuration, group)
        return configuration
# ---------- end ik ----------

# ----
# Place frame
place = GhPythonScript(wall=wall, step=step_2)  # -> frame, a; inputs step: Int32
# ---------- place: Python ----------
import math
from compas.geometry import Rotation
from compas.geometry import Translation
from compas.artists import Artist

frame = list(wall.parts())[step].attributes['place_frame']
a = Artist(frame).draw()
# ---------- end place ----------
ik_2 = InverseKinematics(robot=robot_2, plane=place.frame, start_configuration=home)  # -> configuration; same code as ik

# ----
# Path planning
button = Button()
plan_motion = PlanMotion(robot=robot_2, wall=wall, step=step_2, start_configuration=home, compute=button)  # -> trajectory, trajectory_insertion; inputs step: Int32, attached_collision_meshes: list, compute: Boolean
# ---------- plan_motion: Python ----------
import math
from ghpythonlib.componentbase import executingcomponent as component
from scriptcontext import sticky as st
from compas_fab.robots import PlanningScene
from compas_fab.robots import CollisionMesh

from compas_fab.ghpython.components import create_id


class PlanMotion(component):
    def RunScript(self, robot, wall, step, start_configuration, group, attached_collision_meshes, planner_id, compute):

        key_k = create_id(self, 'trajectory')
        key_c = create_id(self, 'trajectory_cartesian')
        
        tolerance_position = 0.001
        tolerance_xaxis = 1.
        tolerance_yaxis = 1.
        tolerance_zaxis = 1.

        tolerances_axes = [math.radians(tolerance_xaxis), math.radians(tolerance_yaxis), math.radians(tolerance_zaxis)]

        all_parts = list(wall.parts())
        current_part = all_parts[step]
        built_parts = all_parts[0:step]
        
        approach_frame = current_part.attributes['approach_frame']
        goal_constraints = robot.constraints_from_frame(approach_frame, tolerance_position, tolerances_axes, group)

        path_constraints = None
        attached_collision_meshes = list(attached_collision_meshes) if attached_collision_meshes else None
        planner_id = str(planner_id) if planner_id else 'RRTConnectkConfigDefault'

        if robot and robot.client and robot.client.is_connected and start_configuration and goal_constraints and compute:
            static_cm_name = 'built_parts'
            scene = PlanningScene(robot)
            scene.remove_collision_mesh(static_cm_name)
            if built_parts:
                for part in built_parts:
                    cm = CollisionMesh(part.to_mesh(), static_cm_name)
                    scene.append_collision_mesh(cm)
                print('Added {} built parts to scene'.format(len(built_parts)))

            st[key_k] = robot.plan_motion(goal_constraints,
                                        start_configuration=start_configuration,
                                        group=group,
                                        options=dict(
                                            attached_collision_meshes=attached_collision_meshes,
                                            path_constraints=path_constraints,
                                            planner_id=planner_id,
                                        ))

            st[key_c] = robot.plan_cartesian_motion(frames_WCF=[approach_frame, current_part.attributes['place_frame']], start_configuration=st[key_k].points[-1])
            if st[key_c].fraction < 1:
                raise Exception('Failed to calculate insertion motion')

            current_part.attributes['trajectory'] = st.get(key_k)
            current_part.attributes['trajectory_insertion'] = st.get(key_c)

        trajectory = st.get(key_k, None)
        trajectory_insertion = st.get(key_c, None)

        return (trajectory, trajectory_insertion)
# ---------- end plan_motion ----------
list = ValueList({"Placement": 0, "Insertion": 1}, selected="Placement")
filter = StreamFilter(Gate=list, Stream0=plan_motion.trajectory, Stream1=plan_motion.trajectory_insertion)
trajectory_visualize = TrajectoryVisualize(robot=robot_2, trajectory=filter)  # -> start_configuration, configurations, fraction, time, planes, P, V, A
#   port group: The planning group for which this trajectory was planned.
#   port trajectory: The calculated trajectory.
#   port start_configuration: The start configuration of the trajectory.
#   port configurations: The full configurations along the trajectory.
#   port fraction: Indicates the fraction of requested trajectory that was calculated, e.g. 1 means the full trajectory was found.
#   port time: The time which is needed to execute that trajectory at full speed.
#   port planes: The planes of the robot's end-effector.
#   port P: The positions along the trajectory
#   port V: The velocities along the trajectory
#   port A: The accelerations along the trajectory
# ---------- trajectory_visualize: Python ----------
"""
Visualizes a trajectory.

COMPAS FAB v0.19.1
"""
from compas_ghpython import draw_frame
from compas_ghpython import list_to_ghtree
from ghpythonlib.componentbase import executingcomponent as component


class TrajectoryVisualize(component):
    def RunScript(self, robot, group, trajectory):
        start_configuration = None
        configurations = []
        fraction = 0.
        time = 0.

        planes = []
        positions = []
        velocities = []
        accelerations = []

        if robot and trajectory:
            group = group or robot.main_group_name

            for c in trajectory.points:
                configurations.append(robot.merge_group_with_full_configuration(c, trajectory.start_configuration, group))
                frame = robot.forward_kinematics(c, group, options=dict(solver='model'))
                planes.append(draw_frame(frame))
                positions.append(c.positions)
                velocities.append(c.velocities)
                accelerations.append(c.accelerations)

            start_configuration = trajectory.start_configuration
            fraction = trajectory.fraction
            time = trajectory.time_from_start

        P = list_to_ghtree(list(zip(*positions)))
        V = list_to_ghtree(list(zip(*velocities)))
        A = list_to_ghtree(list(zip(*accelerations)))

        # return outputs if you have them; here I try it for you:
        return (start_configuration, configurations, fraction, time, planes, P, V, A)
# ---------- end trajectory_visualize ----------
item = ListItem(List=trajectory_visualize.configurations, Index=Slider(22, range=0..200), Wrap=True)

# ----
# Visualization
list_2 = ValueList({"Home": 0, "Approach frame": 1, "Place frame": 2, "Plan": 3}, selected="Home")
filter_2 = StreamFilter(Gate=list_2, Stream0=home, Stream1=ik, Stream2=ik_2, Stream3=item)
robot_visualize = RobotVisualize(robot=robot_2, configuration=filter_2, reload_scene=True)  # -> visual, collision, attached_meshes, frames, base_frame, ee_frame, collision_meshes; inputs attached_collision_meshes: list, show_visual: Boolean, show_collision: Boolean, show_frames: Boolean, show_base_frame: Boolean, show_end_effector_frame: Boolean, show_acm: Boolean
# ---------- robot_visualize: Python ----------
from compas.geometry import Frame
from compas.geometry import Transformation
from compas_ghpython.artists import FrameArtist
from compas_ghpython.artists import MeshArtist
from ghpythonlib.componentbase import executingcomponent as component
from compas_fab.ghpython.components import create_id
from scriptcontext import sticky as st


class RobotVisualize(component):
    def RunScript(self, robot, group, configuration, attached_collision_meshes, show_visual, show_collision,
                  show_frames, show_base_frame, show_end_effector_frame, show_acm, reload_scene):

        visual = None
        collision = None
        attached_meshes = None
        frames = None
        base_frame = None
        ee_frame = None

        if robot:
            show_visual = True if show_visual is None else show_visual
            configuration = configuration or robot.zero_configuration()

            robot.update(configuration, visual=show_visual, collision=show_collision)
            compas_frames = robot.transformed_frames(configuration, group)

            if show_visual:
                visual = robot.artist.draw_visual()

            if show_collision:
                collision = robot.artist.draw_collision()

            if show_base_frame:
                base_compas_frame = compas_frames[0]
                artist = FrameArtist(base_compas_frame)
                base_frame = artist.draw()

            if show_end_effector_frame:
                ee_compas_frame = robot.forward_kinematics(configuration, group, options=dict(solver='model'))
                artist = FrameArtist(ee_compas_frame)
                ee_frame = artist.draw()

            if show_frames:
                frames = []
                for compas_frame in compas_frames[1:]:
                    artist = FrameArtist(compas_frame)
                    frame = artist.draw()
                    frames.append(frame)

            if show_acm:
                attached_meshes = []
                for acm in attached_collision_meshes:
                    frame = robot.forward_kinematics(configuration, options=dict(solver='model', link_name=acm.link_name))
                    T = Transformation.from_frame_to_frame(Frame.worldXY(), frame)
                    mesh = acm.collision_mesh.mesh.transformed(T)
                    attached_meshes.append(MeshArtist(mesh).draw())

            scene_key = create_id(self, 'scene')
    
            if robot and (reload_scene or scene_key not in st):
                st[scene_key] = robot.client.get_planning_scene()
    
            scene = st.get(scene_key, None)
    
            if scene and robot and robot.client and robot.client.is_connected:
    
                scene_key_co = scene_key + '_co'
                collision_meshes = []
                
                if reload_scene or scene_key_co not in st:
                    for co in scene.world.collision_objects:
                        header = co.header
                        frame_id = header.frame_id
                        cms = co.to_collision_meshes()
    
                        for cm in cms:
                            if frame_id != '/world':
                                raise NotImplementedException('Only world-referenced collision meshes are supported')
    
                            if cm.frame != Frame.worldXY():
                                t = Transformation.from_frame(cm.frame)
                                mesh = cm.mesh.transformed(t)
                            else:
                                mesh = cm.mesh
    
                            rhino_mesh = MeshArtist(mesh).draw_mesh()
                            collision_meshes.append(rhino_mesh)

                    st[scene_key_co] = collision_meshes

        return (visual, collision, attached_meshes, frames, base_frame, ee_frame, collision_meshes)
# ---------- end robot_visualize ----------
